# Grasshopper definition Net Pot.gh (Grasshopper 1.0.7)
# plug-ins: LunchBox, Weaverbird

crv = Curve(<curve referenced from the Rhino model>)
crv_2 = Curve(<curve referenced from the Rhino model>)

# ---- group: revolve axis
pt = Point(Point(0, 0, 1))
pt_2 = Point(Point(0, 0, 0))
ln = Line(StartPoint=pt_2, EndPoint=pt)

# ---- group: curve to be revolved
dom = ConstructDomain(DomainStart=0, DomainEnd=1)
crvdom = CurveDomain(Curve=crv_2, Domain=dom)  # -> Curve, Domain
shatter = Shatter(Curve=crvdom.Curve, Parameters=Slider(1, range=0..1))
item = ListItem(List=shatter, Index=0, Wrap=True)

# ---- group: lip
revsrf = Revolution(Curve=crv, Axis=ln, Domain=Domain(0, 6.283185307))
preview = CustomPreview(
    Geometry=revsrf,
    Material={diffuse=RGB(221, 160, 221), emission=RGB(66, 48, 66), shine=0.5, specular=RGB(255, 255, 255), transparency=0})

# ----
revsrf_2 = Revolution(Curve=item, Axis=ln, Domain=Domain(0, 6.283185307))
bbox = BoundingBox(Content=revsrf_2, Plane=PlaneXY(0, 0, 0))  # -> Box, Box_2
popgeo = PopulateGeometry(Geometry=revsrf_2, Count=Slider(350, range=0..1000), Seed=Slider(15048498, range=0..30000000))
dam = DataDam(DataA=popgeo, BufferDelay=10000000, BufferMode=0)
voronoi³ = Voronoi3D(Points=dam, Box=bbox.Box)  # -> Cells, Boundary
bbx = BrepBrep(BrepA=revsrf_2, BrepB=voronoi³.Cells)  # -> Curves, Points
item_2 = ListItem(List=bbx.Curves, Index=Slider(1, range=0..1), Wrap=True)  # -> flatten(Item)

# ---- group: only take closed curves
panel = Panel(item_2)
tmatch = MatchText(Text=panel, Pattern="Closed Curve", Case=True)
cull = CullPattern(List=item_2, CullPattern=tmatch)

# ---- group: phyllo attempt
fib = Fibonacci(SeedA=0, SeedB=1, Number=10)
series = Series(Start=Slider(7, range=0..10), Step=1, Count=2)
item_3 = ListItem(List=fib, Index=series, Wrap=True)  # -> flatten(Item)
phyllosurf = PhylloSurface(Srf=revsrf_2, PN=item_3, t=Slider(300, range=0..1000), C=False, F=False)  # -> out, M; inputs Srf: Surface, PN: list, t: list
#   port PN: In/Decrease twist rate Two consecutive Fibonacci numbers to sew the mesh, depending on the length of the curve, the number of parameters and the radii To flip the mesh, reverse this list of parameters
# ---------- phyllosurf: VB ----------
    '
    'PhylloMachine v1.0
    'Code of PhylloSurface developed by Daniel González Abalde in Spring 2015, released under the GNU 3.0 license, as all files of PhylloMachine.
    'Your are free to modify, copy and derive, but must be subject to this license.
    'Your are free to use the designs made with PhylloMachine for commercial purposes. Consider the option to reward the author, or at least allow to see the product or project.
    'This plugin comes without warranty of any kind, but feel free to contact the author for any PhylloMachine related subject via email to dga_3@hotmail.com. You can also follow his work from facebook.com/DanielAbaldeDesigner
    'Enjoy! ツ
    '
    Component.Params.Input(0).Name = "Surface"
    Component.Params.Input(0).Description = "Base surface"
    Component.Params.Input(1).Name = "Parastichy numbers"
    Component.Params.Input(1).Description = "In/Decrease twist rate" & vbCrLf & "Two consecutive Fibonacci numbers to sew the mesh, depending on the length of the curve, the number of parameters and the radii" & vbCrLf & "To flip the mesh, reverse this list of parameters"
    Component.Params.Input(2).Name = "Parameters"
    Component.Params.Input(2).Description = "A list of normalized parameters which evaluate the surface for placing vertices, or an integer value for uniform placing"
    Component.Params.Input(3).Name = "Close"
    Component.Params.Input(3).Description = "Close the mesh "
    Component.Params.Input(4).Name = "Flip"
    Component.Params.Input(4).Description = "Flip the UV coordinates"

    Component.Params.Output(1).Name = "PhylloSurf"
    Component.Params.Output(1).Description = "PhylloSurf"
    '
    If Srf Is Nothing Then Return

    Dim tlist As New list(Of Double)
    If t.Count = 1 Then
      For j As int32 = 0 To t(0) - 1
        tlist.add(j / (t(0) - 1))
      Next
    Else
      tlist = t
    End If

    Dim circle As New circle(1)
    Dim cyl As New Cylinder(circle, 1)
    Dim cyls As  NurbsSurface = Nurbssurface.CreateFromCylinder(cyl)
    cyls.SetDomain(0, New interval(0, 1))
    cyls.SetDomain(1, New interval(0, 1))
    Srf.SetDomain(0, New interval(0, 1))
    Srf.SetDomain(1, New interval(0, 1))

    Dim br As brep = Srf.ToBrep()
    Dim edges As New list(Of Curve)
    edges.addRange(br.DuplicateEdgeCurves())
    Dim dg As Curve
    Dim ie As New Integer
    If edges.count > 1 Then

      If F = False Then ie = 0
      If F = True Then ie = 1
      dg = edges(ie)
    Else
      dg = edges(0)
    End If
    '
    'Points.
    Dim pts As New List (Of point3d)
    Dim norm As New List(Of vector3d)

    For i As int32 = 0 To tlist.count - 1
      Dim phi As Double = RhinoMath.ToRadians(137.5)
      Dim x As Double = math.Cos((phi * i))
      Dim y As Double = math.Sin((phi * i))
      'Dim z As Double = i/(tlist.count -1)
      Dim z As Double = tlist(i)
      Dim ptn As Point3d = New point3d(x, y, z)
      Dim uc, vc As New Double
      If F = False Then
        cyls.ClosestPoint(ptn, uc, vc)
      Else
        cyls.ClosestPoint(ptn, vc, uc)
      End If
      Dim pton As point3d = Srf.PointAt(uc, vc)
      pts.add(pton)
      Dim normon As vector3d = Srf.NormalAt(uc, vc)
      norm.add(normon)
    Next
    '
    '
    Dim F0, F1, F2 As New Integer
    F0 = PN(0)
    F1 = PN(1)
    F2 = PN(0) + PN(1)
    '
    Dim mesh As New mesh
    '
    Dim Ai,Bi,Ci,Di As New Integer
    For i As int32 = 0 To pts.count - 1 - F2
      Ai = i
      Bi = i + F0
      Ci = i + F2
      Di = i + F1
      mesh.Faces.AddFace(New meshFace(Ai, Bi, Ci, Di))
    Next
    '
    mesh.Vertices.AddVertices(pts)
    mesh.Vertices.CullUnused()
    mesh.Vertices.CombineIdentical(False, False)

    mesh.Faces.CullDegenerateFaces()

    mesh.FaceNormals.ComputeFaceNormals()
    mesh.FaceNormals.UnitizeFaceNormals()

    mesh.Normals.ComputeNormals()
    mesh.UnifyNormals()
    '
    If C Then
      Dim arrnaked As curve() = br.DuplicateNakedEdgeCurves(True, True)
      Dim naked As New list(Of curve)
      naked.addRange(arrnaked)

      If naked.count = 0 Then
        If srf.IsSphere() Then
          Dim ptes As point3d = edges(0).PointAtStart()
          Dim pten As point3d = edges(0).PointAtEnd()
          For j As int32 = 0 To F2 - 1
            mesh.Vertices.SetVertex(j, ptes)
            mesh.Vertices.setVertex(pts.count - 1 - j, pten)
          Next
        Else
          Dim ptslist As New point3dlist(mesh.Vertices.ToPoint3dArray())
          Dim nkde As polyline() = mesh.GetNakedEdges()
          For j As int32 = 0 To nkde.count - 1
            Dim avpt As point3d = nkde(j).CenterPoint()
            For k As int32 = 0 To nkde(j).count - 1
              Dim idx As Integer = ptslist.ClosestIndex(nkde(j).item(k))
              mesh.Vertices.SetVertex(idx, avpt)
            Next
          Next

        End If
      Else
        If srf.IsCone() Then
          Dim conn As cone
          srf.TryGetCone(conn)
          Dim ptes As point3d = conn.ApexPoint
          Dim pten As point3d = conn.BasePoint
          For j As int32 = 0 To F2 - 1
            mesh.Vertices.SetVertex(j, ptes)
            mesh.Vertices.setVertex(pts.count - 1 - j, pten)
          Next

        End If
      End If
    Else
      If Srf.IsPeriodic(F) = False Then
        Dim perlist As New list(Of Double)
        Dim perav As New Double
        For j As int32 = 0 To mesh.Faces.Count - 1
          Dim mf As meshFace = mesh.Faces.item(j)
          Dim mref As New mesh
          mref.Vertices.AddVertices(pts)
          mref.Faces.addFace(New meshFace(mf.A, mf.B, mf.C, mf.D))
          mref.Vertices.CullUnused()
          Dim mn As polyline = mref.GetNakedEdges(0)
          Dim refleng As Double = mn.Length
          perlist.add(refleng)
          perav += refleng
        Next

        Dim average As Double = perav / mesh.Faces.Count
        Dim icull As New list(Of Integer)

        For j As int32 = 0 To perlist.count - 1
          If perlist(j) > average * factorToCull Then
            icull.add(j)
          End If

        Next
        mesh.Faces.DeleteFaces(icull)
      End If
    End If
    '
    '
    mesh.Faces.CullDegenerateFaces()
    mesh.Compact()
    mesh.Vertices.CombineIdentical(True, True)
    '

    '
    M = mesh
    '
# ---------- phyllosurf: VB additional code ----------
  Dim factorToCull As Double = 1.6 'If unexpected faces appear, set this parameter to eliminate them. Also you can try to turn the UV.
# ---------- end phyllosurf ----------
wbframe = WeaverbirdsPictureFrame(MeshPolylines=phyllosurf.M, Distance=Slider(8, range=0..100), InsetType=0)

# ---- group: hex iteration
hex = HexagonCells(Surface=revsrf_2, UDivisions=Slider(61, range=0..100), VDivisions=Slider(18, range=0..100), TParameter=0.25)  # -> HexagonCells, Centers
wbframe_2 = WeaverbirdsPictureFrame(MeshPolylines=hex.HexagonCells, Distance=Slider(12, range=0..100), InsetType=0)

# ----
disc = Discontinuity(Curve=cull, Level=1)  # -> Points, Parameters
avr = Average(Input=disc.Points)
pline = PolyLine(Vertices=disc.Points, Closed=True)
scale = Scale(Geometry=pline, Center=avr, Factor=Slider(0.78, range=0..1))  # -> Geometry, Transform
loft = Loft(
    Curves=[pline, scale.Geometry],
    Options={Adjust=False, Closed=False, LoftEnds=0, LoftSimp=0, LoftType=0, Rebuild=10, Refit=0.01})
join = BrepJoin(Breps=loft)  # -> Breps, Closed
number_slider = Slider(1, range=0..1)

# ---- group: phyllo attempt / mesh thickness
neg = Negative(Value=Slider(0.063, range=0..1))
wbthicken = WeaverbirdsMeshThicken(MeshCurves=wbframe, Distance=neg, OffsetType=0)

# ----
debrep = DeconstructBrep(Brep=join.Breps)  # -> Faces, Edges, Vertices
mesh_uv = MeshSurface(Surface=debrep.Faces, UCount=number_slider, VCount=number_slider, Overhang=True, Equalize=False)  # -> flatten(Mesh)
wbjoin = WeaverbirdsJoinMeshesAndWeld(Mesh=mesh_uv, Weld=False)
neg_2 = Negative(Value=Slider(0.06, range=0..1))
wbthicken_2 = WeaverbirdsMeshThicken(MeshCurves=wbjoin, Distance=neg_2, OffsetType=0)

# ---- group: mesh curving
wbcatmullclark = WeaverbirdsCatmullClarkSubdivision(MeshCurves=wbthicken, Level=Slider(3, range=0..10), SmoothNakedEdges=1)  # disabled
wbsplitquads = WeaverbirdsConstantQuadsSplitSubdivision(MeshCurves=wbthicken, Level=Slider(3, range=0..10), SmoothNakedEdges=1)  # disabled
preview_2 = CustomPreview(
    Geometry=wbcatmullclark,
    Material={diffuse=RGB(221, 160, 221), emission=RGB(66, 48, 66), shine=0.5, specular=RGB(255, 255, 255), transparency=0})

# ----
wbcatmullclark_2 = WeaverbirdsCatmullClarkSubdivision(MeshCurves=wbthicken_2, Level=Slider(4, range=0..10), SmoothNakedEdges=1)
preview_3 = CustomPreview(
    Geometry=wbcatmullclark_2,
    Material={diffuse=RGB(221, 160, 221), emission=RGB(66, 48, 66), shine=0.5, specular=RGB(255, 255, 255), transparency=0})
