# Grasshopper definition hexextrusiosn.gh (Grasshopper 1.0.7)

number_slider = Slider(15, range=0..30)
xy = XYPlane(Origin=Point(0, 0, 0))
trigrid = Triangular(Plane=xy, Size=Slider(0.25, range=0..1), ExtentX=number_slider, ExtentY=number_slider)  # -> Cells, Points
neg = Negative(Value=Slider(0.024, range=0..1))
crv = Curve(<curve referenced from the Rhino model>)
offset = OffsetCurve(Curve=trigrid.Cells, Distance=neg, Plane=PlaneXY(0, 0, 0), Corners=1)
rint = RegionIntersection(CurvesA=crv, CurvesB=offset)
Z = UnitZ(Factor=1)
extr = Extrude(Base=rint, Direction=Z)
cap = CapHoles(Brep=extr)
